% Simulink data dictionary LGS_Data.sldd

Bus_Aircraft_State = Simulink.Bus()
  Z_Position: double
  Z_Velocity: double
  Pitch_Angle: double

Bus_Avionics_In = Simulink.Bus()
  Brake_Cmd: double
  Channel_Select: boolean
  BIT_Trigger: uint8

Bus_Env_Power = Simulink.Bus()
  Vdc_1: double
  Vdc_2: double
  Mu_Ground: double
  Theta_Runway: double

Bus_LGS_Dynamics = Simulink.Bus()
  Force_XYZ: double[3]
  Moment_XYZ: double[3]

Bus_LGS_Feedback = Simulink.Bus()
  WOW_Nose: boolean
  WOW_LeftMain: boolean
  WOW_RightMain: boolean
  Brake_Pressure_FB: double
  Fault_Status_Word: uint16